# Grasshopper definition RazerHydraObjectManipulation.gh (Grasshopper 0.9.76)
# plug-ins: Firefly.X, EleFront, gHowl, HDTReference, Starling, Firefly.Core

toggle = BooleanToggle(True)
not = GateNot(A=toggle)
disable_timer = VBScript(pause=not)  # -> out
# ---------- disable_timer: VB ----------
    Dim ghdoc As GH_Document = owner.OnPingDocument()
    If (ghdoc Is Nothing) Then Return
    'Then, iterate over all objects in the document to find all timers.
    For Each docobj As IGH_DocumentObject In ghdoc.Objects
      'Try to cast the object to a GH_Timer
      Dim timer As Special.GH_Timer = TryCast(docobj, Special.GH_Timer)
      If (timer Is Nothing) Then Continue For
      'If the cast was successful, then see if this component is
      'part of the timer target list.
      If (timer.Targets.Contains(owner.InstanceGuid)) Then
        'If it is, lock the timer.
        timer.Locked = pause
      End If
    Next
# ---------- disable_timer: VB additional code ----------
  Dim timer As New System.Windows.Forms.Timer
  Dim pause As Boolean
# ---------- end disable_timer ----------
timer = Timer(TimerInterval=50, Target=[selobj, disable_timer, bang])
udp = UDPReceiver(Address="127.0.0.1", Port="7022", Pattern="999")  # -> Info, Data
filter = StreamFilter(Gate=toggle, Stream1=udp.Data)
dispatch = Dispatch(List=filter, DispatchPattern=[True, False])  # -> ListA, ListB
item = ListItem(List=dispatch.ListB, Index="11", Wrap=True)
opentrack_info = Panel(dispatch.ListA)
item_2 = ListItem(List=dispatch.ListB, Index="5", Wrap=True)
larger = LargerThan(FirstNumber=item, SecondNumber=Slider(1, range=0..1))  # -> LargerThan, OrEqualTo
larger_2 = LargerThan(FirstNumber=item_2, SecondNumber=Slider(1, range=0..1))  # -> LargerThan, OrEqualTo
opentrack_info_2 = Panel(dispatch.ListB)
dom = ConstructDomain(DomainStart="13", DomainEnd="16")
dom_2 = ConstructDomain(DomainStart="0", DomainEnd="2")
bang = Bang(BooleanInput=larger.OrEqualTo)  # -> TrueState, FalseState
subset = SubList(List=dispatch.ListB, Domain=dom, Wrap=True)  # -> graft(List), Index
pi = Pi(Factor=1)
subset_2 = SubList(List=dispatch.ListB, Domain=dom_2, Wrap=True)  # -> graft(List), Index
division = Division(A=pi, B=Slider(15, range=0..30))
cluster = Cluster(A=subset_2.List, num=Slider(21, range=0..30))
cluster_2 = Cluster(A=subset.List, num=Slider(0.1, range=0..0.1))
filter_2 = StreamFilter(Gate=Toggle(False), Stream0=subset_2.List, Stream1=cluster)
filter_3 = StreamFilter(Gate=Toggle(False), Stream0=subset.List, Stream1=cluster_2)
selobj = ObjectsBySelection(Reset=toggle)  # -> SelectedGeometry, ObjectAttributes
bang_2 = ExplodeTree(Data=filter_2)  # -> Branch0, Branch1, Branch2, Branch3
bang_3 = ExplodeTree(Data=filter_3)  # -> Branch0, Branch1, Branch2, Branch3
neg = Negative(Value=bang_2.Branch2)
calibrate = Button()
sortbytype = SortObjectsByType(RhinoObjects=selobj.SelectedGeometry)  # -> Points, Curves, Surfaces, Breps, Meshes, TextObjects, HatchObjects, LightObjects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
panel = Panel(cluster_2)
pt = ConstructPoint(XCoordinate=bang_2.Branch0, YCoordinate=neg, ZCoordinate=bang_2.Branch1)
geo = Geometry([sortbytype.Extrusions, sortbytype.Surfaces, sortbytype.Breps, sortbytype.Meshes, sortbytype.Points])
split = SplitList(List=geo, Index=Slider(10, range=0..10))  # -> ListA, ListB
log = DataLog(IncomingData=pt, ResetLog=calibrate, StartRecording=True, WrapValues=False, RecordingLength=1)
subtraction = Subtraction(A=pt, B=log)
boxprop = BoxProperties(Box=split.ListA)  # -> Center, Diagonal, Area, Volume, Degeneracy
geo_2 = Geometry(split.ListA)
panel_2 = Panel(log)
geo_3 = Geometry(subtraction)
avr = Average(Input=boxprop.Center)
quaterniontomatrix = CSharpScript(x=bang_3.Branch0, y=bang_3.Branch2, z=bang_3.Branch1, w=bang_3.Branch3, rotCenter=avr)  # -> out, A, Transform; inputs x: Double, y: Double, z: Double, w: Double, rotCenter: Point3d
# ---------- quaterniontomatrix: C# ----------
    double cx = rotCenter[0];
    double cy = rotCenter[1];
    double cz = rotCenter[2];
/*
    double xx = x * x;
    double xy = x * y;
    double xz = x * z;
    double xw = x * q;

    double yy = y * y;
    double yz = y * z;
    double yw = y * q;

    double zz = z * z;
    double zw = z * q;

    Double[] f = new Double[]
      { 1 - 2 * (yy + zz), 2 * (xy - zw), 2 * (xz + yw), 0 ,
      2 * (xy + zw), 1 - 2 * (xx + zz), 2 * (yz - xw), 0 ,
      2 * (xz - yw), 2 * (yz + xw), 1 - 2 * (xx + yy), 0 ,
      0, 0, 0, 1 };
    A = f;*/


    var q = new { x = -x, y = y, z = -z, w = w};

    double sqw = q.w * q.w;
    double sqx = q.x * q.x;
    double sqy = q.y * q.y;
    double sqz = q.z * q.z;
    double m00 = sqx - sqy - sqz + sqw; // since sqw + sqx + sqy + sqz =1
    double m11 = -sqx + sqy - sqz + sqw;
    double m22 = -sqx - sqy + sqz + sqw;

    double tmp1 = q.x * q.y;
    double tmp2 = q.z * q.w;
    double m01 = 2.0 * (tmp1 + tmp2);
    double m10 = 2.0 * (tmp1 - tmp2);

    tmp1 = q.x * q.z;
    tmp2 = q.y * q.w;
    double m02 = 2.0 * (tmp1 - tmp2);
    double m20 = 2.0 * (tmp1 + tmp2);

    tmp1 = q.y * q.z;
    tmp2 = q.x * q.w;
    double m12 = 2.0 * (tmp1 + tmp2);
    double m21 = 2.0 * (tmp1 - tmp2);

    double a1,a2,a3;
    if (rotCenter == null) {
      a1 = a2 = a3 = 0;
    } else {
      a1 = cx;
      a2 = cy;
      a3 = cz;
    }
    double m03 = a1 - a1 * m00 - a2 * m01 - a3 * m02;
    double m13 = a2 - a1 * m10 - a2 * m11 - a3 * m12;
    double m23 = a3 - a1 * m20 - a2 * m21 - a3 * m22;
    double m30 = 0.0;
    double m31 = 0.0;
    double m32 = 0.0;
    double m33 = 1.0;


    Double[] f = new Double[]
      { m00, m01, m02, m03,
      m10, m11, m12, m13,
      m20, m21, m22, m23,
      m30, m31, m32, m33};


    Double[,] g = new Double[4, 4]
      {
      { m00, m01, m02, m03},
      {m10, m11, m12, m13},
      {m20, m21, m22, m23},
      {m30, m31, m32, m33}
      };

    Transform T = new Transform();

    T[0, 0] = m00;
    T[0, 1] = m01;
    T[0, 2] = m02;
    T[0, 3] = m03;
    T[1, 0] = m10;
    T[1, 1] = m11;
    T[1, 2] = m12;
    T[1, 3] = m13;
    T[2, 0] = m20;
    T[2, 1] = m21;
    T[2, 2] = m22;
    T[2, 3] = m23;
    T[3, 0] = m30;
    T[3, 1] = m31;
    T[3, 2] = m32;
    T[3, 3] = m33;
    Transform = T;
    A = f;
# ---------- end quaterniontomatrix ----------
matrix = TransformMatrix(quaterniontomatrix.A, Digits=3)
transform = Transform(Geometry=geo_2, Transform=quaterniontomatrix.Transform)
vec2pt = Vector2Pt(PointA=avr, PointB=geo_3, Unitize=False)  # -> Vector, Length
move = Move(Geometry=transform, Motion=vec2pt.Vector)  # -> Geometry, Transform
r_matrix = Data()
filter_4 = StreamFilter(Gate=larger_2.OrEqualTo, Stream0="Addition", Stream1="Subtraction")
attributes = ObjectAttributes(Layer=filter_4)
dpipeline = DynamicGeometryPipeline(
    LayerFilter="Addition",
    TypeFilter="All",
    NameFilter="*",
    enableFullPath=False,
    GroupByLayer=False,
    GroupByType=False,
    IncludeHidden=True,
    IncludeLocked=True)
dpipeline_2 = DynamicGeometryPipeline(
    LayerFilter="Subtraction",
    TypeFilter="All",
    NameFilter="*",
    enableFullPath=False,
    GroupByLayer=False,
    GroupByType=False,
    IncludeHidden=True,
    IncludeLocked=True)
preview = CustomPreview(Geometry=move.Geometry, Shader=ColourSwatch(SwatchColor=RGBA(255, 255, 255, 133)))
bake = BakeObjects(Geometry=move.Geometry, Attributes=attributes, Bake=bang.TrueState)
srf = Surface(dpipeline)
brep = Brep(dpipeline)
mesh = Mesh(dpipeline)
pt_2 = Point(dpipeline)
srf_2 = Surface(dpipeline_2)
brep_2 = Brep(dpipeline_2)
mesh_2 = Mesh(dpipeline_2)
pt_3 = Point(dpipeline_2)
clean = CleanTree(RemoveNulls=True, RemoveInvalid=True, RemoveEmpty=False, Tree=srf)
clean_2 = CleanTree(RemoveNulls=True, RemoveInvalid=True, RemoveEmpty=False, Tree=mesh)
clean_3 = CleanTree(RemoveNulls=True, RemoveInvalid=True, RemoveEmpty=False, Tree=brep)
clean_4 = CleanTree(RemoveNulls=True, RemoveInvalid=True, RemoveEmpty=False, Tree=pt_2)
clean_5 = CleanTree(RemoveNulls=True, RemoveInvalid=True, RemoveEmpty=False, Tree=srf_2)
clean_6 = CleanTree(RemoveNulls=True, RemoveInvalid=True, RemoveEmpty=False, Tree=mesh_2)
clean_7 = CleanTree(RemoveNulls=True, RemoveInvalid=True, RemoveEmpty=False, Tree=brep_2)
clean_8 = CleanTree(RemoveNulls=True, RemoveInvalid=True, RemoveEmpty=False, Tree=pt_3)
slhull3d = SlHull3D(Point3d=clean_4)
slhull3d_2 = SlHull3D(Point3d=clean_8)
medges = MeshEdges(Mesh=slhull3d)  # -> NakedEdges, InteriorEdges, NonManifoldEdges
medges_2 = MeshEdges(Mesh=slhull3d_2)  # -> NakedEdges, InteriorEdges, NonManifoldEdges
preview_2 = CustomPreview(Geometry=slhull3d, Shader=ColourSwatch(SwatchColor=RGBA(64, 207, 176, 196)))
preview_3 = CustomPreview(
    Geometry=[medges.NonManifoldEdges, medges.InteriorEdges, medges.NakedEdges],
    Shader=ColourSwatch(SwatchColor=RGBA(37, 120, 102, 159)))
preview_4 = CustomPreview(
    Geometry=[medges_2.NonManifoldEdges, medges_2.InteriorEdges, medges_2.NakedEdges],
    Shader=ColourSwatch(SwatchColor=RGBA(102, 16, 85, 159)))
preview_5 = CustomPreview(Geometry=slhull3d_2, Shader=ColourSwatch(SwatchColor=RGBA(207, 64, 154, 196)))
mdif = MeshDifference(MeshesA=slhull3d, MeshesB=slhull3d_2)
medges_3 = MeshEdges(Mesh=mdif)  # -> NakedEdges, InteriorEdges, NonManifoldEdges
preview_6 = CustomPreview(Geometry=slhull3d, Shader=ColourSwatch(SwatchColor=RGBA(203, 191, 224, 196)))
preview_7 = CustomPreview(
    Geometry=[medges_3.NonManifoldEdges, medges_3.InteriorEdges, medges_3.NakedEdges],
    Shader=ColourSwatch(SwatchColor=RGBA(92, 88, 83, 159)))

# ==== cluster Cluster
num = ClusterInput()
A = ClusterInput()
num_2 = Number(num)
division = Division(A=A, B=num_2)
round = Round(Number=division)  # -> Nearest, Floor, Ceiling
multiplication = Multiplication(A=round.Nearest, B=num_2)
R = ClusterOutput(multiplication)
