# Grasshopper definition MeshToJson.gh (Grasshopper 0.9.76)
# plug-ins: MeshEdit Components, gHowl

number_slider = Slider(7, range=0..10)
geo = Geometry([<point referenced from the Rhino model> x5])
msphere = MeshSphere(Base=geo, Radius=Slider(1, range=0..10), UCount=number_slider, VCount=number_slider)
triangulate = MeshTriangulate(Mesh=msphere, ShortDiagonal=True)
demesh = DeconstructMesh(Mesh=triangulate)  # -> Vertices, simplify(Faces), Colours, Normals
panel = Panel(demesh.Faces)
lng = ListLength(List=demesh.Vertices)  # -> flatten(Length)
rep = ReplaceText(Text=panel, Find="T{", RecursiveReplace=False)
item = ListItem(List=lng, Index=0, Wrap=True)
ma = MassAddition(Input=lng)  # -> Result, simplify(graft(PartialResults))
rep_2 = ReplaceText(Text=rep, Find="}", RecursiveReplace=False)
subtraction = Subtraction(A=ma.PartialResults, B=item)
split = TextSplit(Text=rep_2, Separators=";")
panel_2 = Panel(subtraction)
lng_2 = ListLength(List=rep_2)
repeat = RepeatData(Data=simplify(panel_2), Length=simplify(lng_2))  # -> simplify(graft(Data))
panel_3 = Panel(demesh.Vertices)
panel_4 = Panel("""{
"vertices": [
$VERTEX$
],
"faces": [
$FACE$
]
}""")
addition = Addition(A=repeat, B=split)
panel_5 = Panel(repeat)
pshift = ShiftPaths(Offset=-1)
rep_3 = ReplaceText(Text=demesh.Faces, Find="T{", Replace="{ \"face\":[", RecursiveReplace=False)
rep_4 = ReplaceText(Text=flatten(demesh.Vertices), Find="{", Replace="{ \"vertex\":[", RecursiveReplace=False)
join = TextJoin(Text=addition, Join=",")
rep_5 = ReplaceText(Text=rep_4, Find="}", Replace="]},", RecursiveReplace=False)
rep_6 = ReplaceText(Text=rep_3, Find=";", Replace=",", RecursiveReplace=False)
join_2 = TextJoin(Text=rep_5)
concat = Concatenate(FragmentA="{ \"face\":[", FragmentB=join)
rep_7 = ReplaceText(Text=rep_6, Find="}", Replace="]},", RecursiveReplace=False)
rep_8 = ReplaceText(Text=panel_4, Find="$VERTEX$", Replace=join_2, RecursiveReplace=False)
concat_2 = Concatenate(FragmentA=concat, FragmentB="]},")  # -> flatten(Result)
join_3 = TextJoin(Text=concat_2)
panel_6 = Panel("""},
]""")
panel_7 = Panel("""}
]""")
rep_9 = ReplaceText(Text=rep_8, Find="$FACE$", Replace=join_3, RecursiveReplace=False)
panel_8 = Panel(concat_2)
rep_10 = ReplaceText(Text=rep_9, Find=panel_6, Replace=panel_7, RecursiveReplace=False)
panel_9 = Panel(rep_10)
udp = UDPSender(Port=6001, Pattern=0, Data=rep_9)
panel_10 = Panel(udp)
