# Grasshopper definition RhinoRiftSketch - LucidDreaming.ghx (Grasshopper 0.9.76)
# plug-ins: MeshEdit Components, LunchBox

path = FilePath("C:\Users\provolot\Documents\GitHub\provolot.github.io\RiftSketch\data\data.obj")
saveobj = Button()
pipeline = GeometryPipeline(
    GroupByLayer=False,
    GroupByType=False,
    IncludeHidden=True,
    IncludeLocked=True,
    LayerFilter="MyHead",
    NameFilter="*",
    TypeFilter=1073741880)
pipeline_2 = GeometryPipeline(
    GroupByLayer=False,
    GroupByType=False,
    IncludeHidden=True,
    IncludeLocked=True,
    LayerFilter="MyOffice",
    NameFilter="*",
    TypeFilter=1073741880)
split = TextSplit(Text=path, Separators="\")
pipeline_3 = GeometryPipeline(
    GroupByLayer=False,
    GroupByType=False,
    IncludeHidden=True,
    IncludeLocked=True,
    LayerFilter="Creation",
    NameFilter="*",
    TypeFilter=1073741880)
split_2 = SplitList(List=reverse(split), Index="1")  # -> ListA, reverse(ListB)
join = TextJoin(Text=split_2.ListB, Join="\")
jagged = SettingsSpeed()
meshify = Meshify(S=jagged, geo=pipeline)
meshify_2 = Meshify(S=jagged, geo=pipeline_3)
meshify_3 = Meshify(S=jagged, geo=pipeline_2)
concat = Concatenate(FragmentA="data", FragmentB=".obj")
convquads = MeshConvertQuads(Mesh=meshify_2, ShortDiagonal=True)  # -> Mesh, Splitted
shrinkfactor = Slider(22, range=3..30)
lowerleftpoint = LowerLeftPoint(geo=meshify_3)

toggle_smaller = BooleanToggle(True)
toggle_larger = BooleanToggle(True)

geo = Geometry(<point referenced from the Rhino model>)
scaledownup = ScaleDownUp(geo_3=lowerleftpoint, B=geo, geo=convquads.Mesh, x=shrinkfactor)  # -> G_2, G
scaledownup_2 = ScaleDownUp(geo_3=lowerleftpoint, B=geo, geo=meshify_3, x=shrinkfactor)  # -> G_2, G
scaledownup_3 = ScaleDownUp(geo_3=lowerleftpoint, B=geo, geo=meshify, x=shrinkfactor)  # -> G_2, G
bool = Boolean(toggle_smaller)
filter = StreamFilter(Gate=bool, Stream1=scaledownup_2.G)
filter_2 = StreamFilter(Gate=toggle_larger, Stream1=scaledownup_2.G_2)
filter_3 = StreamFilter(Gate=toggle_larger, Stream1=scaledownup.G_2)
filter_4 = StreamFilter(Gate=bool, Stream1=scaledownup.G)
filter_5 = StreamFilter(Gate=bool, Stream1=scaledownup_3.G)
filter_6 = StreamFilter(Gate=toggle_larger, Stream1=scaledownup_3.G_2)
geo_2 = Geometry(flatten([filter_2, filter, meshify_3]))
geo_3 = Geometry(flatten([filter_3, filter_4, convquads.Mesh]))
geo_4 = Geometry(flatten([filter_6, filter_5, meshify_3]))
geo_5 = Geometry(flatten([geo_2, geo_4]))
geo_6 = Geometry(flatten([geo_5, geo_3]))
clean = CleanTree(RemoveNulls=True, RemoveInvalid=True, RemoveEmpty=False, Tree=geo_6)
clean_2 = CleanTree(RemoveNulls=True, RemoveInvalid=True, RemoveEmpty=False, Tree=geo_5)
clean_3 = CleanTree(RemoveNulls=True, RemoveInvalid=True, RemoveEmpty=False, Tree=geo_3)
preview = CustomPreview(Geometry=flatten(clean_3), Shader=ColourSwatch(SwatchColor=RGB(95, 62, 240)))
preview_2 = CustomPreview(Geometry=flatten(clean_2), Shader=ColourSwatch(SwatchColor=RGB(117, 106, 106)))
save = ObjectSave(
    BakeToggle=saveobj,
    FileDirectory=join,
    FileName=concat,
    GeometryObjects=clean,
    Layer="GH_Export",
    ObjectName="GH_Obj",
    ObjectColor=RGB(255, 255, 255),
    LayerColor=RGB(255, 255, 255))

# ==== cluster Meshify
geo = ClusterInput()
geo_2 = Geometry(geo)
brep = Brep(geo_2)
mesh = Mesh(geo_2)
clean = CleanTree(RemoveNulls=True, RemoveInvalid=True, RemoveEmpty=False, Tree=brep)
S = ClusterInput()
clean_2 = CleanTree(RemoveNulls=True, RemoveInvalid=True, RemoveEmpty=False, Tree=mesh)
mesh_2 = MeshBrep(Brep=clean, Settings=S)
geo_3 = Geometry([mesh_2, clean_2])
geo_4 = ClusterOutput(geo_3)

# ==== cluster ScaleDownUp
geo = ClusterInput()
pt = ConstructPoint(XCoordinate=0, YCoordinate=0, ZCoordinate=0)
geo_2 = Geometry(geo)
x = ClusterInput()
geo_3 = ClusterInput()
geo_4 = Geometry(geo_3)
B = ClusterInput()
one_over_x = OneOverX(Value=x)
scale = Scale(Geometry=geo_2, Center=geo_4, Factor=one_over_x)  # -> Geometry, Transform
one_over_x_2 = OneOverX(Value=one_over_x)
vec2pt = Vector2Pt(PointA=geo_4, PointB=B, Unitize=False)  # -> Vector, Length
scale_2 = Scale(Geometry=geo_2, Center=geo_4, Factor=one_over_x_2)  # -> Geometry, Transform
rev = Reverse(Vector=vec2pt.Vector)
multiplication = Multiplication(A=rev, B=one_over_x_2)
move = Move(Geometry=scale.Geometry, Motion=vec2pt.Vector)  # -> Geometry, Transform
move_2 = Move(Geometry=scale_2.Geometry, Motion=multiplication)  # -> Geometry, Transform
G = ClusterOutput(move.Geometry)
G_2 = ClusterOutput(move_2.Geometry)

# ==== cluster LowerLeftPoint
geo = ClusterInput()
geo_2 = Geometry(geo)
bbox = BoundingBox(Content=geo_2, Plane=PlaneXY(0, 0, 0), UnionBox=True)  # -> Box, Box_2
debrep = DeconstructBrep(Brep=bbox.Box)  # -> Faces, Edges, Vertices
sort_pt = SortPoints(Points=debrep.Vertices)  # -> Points, Indices
item = ListItem(List=sort_pt.Points, Index=0, Wrap=True)
pt = Geometry(item)
pt_2 = ClusterOutput(pt)
