# Grasshopper definition SaveOBJ.ghx (Grasshopper 0.9.76)
# plug-ins: MeshEdit Components, LunchBox

path = FilePath("C:\Users\provolot\Documents\GitHub\provolot.github.io\RiftSketch\data\data.obj")
saveobj = Button()
pipeline = GeometryPipeline(
    GroupByLayer=False,
    GroupByType=False,
    IncludeHidden=True,
    IncludeLocked=True,
    LayerFilter="MyOffice",
    NameFilter="*",
    TypeFilter=1073741880)
split = TextSplit(Text=path, Separators="\")
split_2 = SplitList(List=reverse(split), Index="1")  # -> ListA, reverse(ListB)
pipeline_2 = GeometryPipeline(
    GroupByLayer=False,
    GroupByType=False,
    IncludeHidden=True,
    IncludeLocked=True,
    LayerFilter="Creation",
    NameFilter="*",
    TypeFilter=1073741880)
join = TextJoin(Text=split_2.ListB, Join="\")
jagged = SettingsSpeed()
meshify = Meshify(S=jagged, geo=pipeline)
meshify_2 = Meshify_2(S=jagged, geo=pipeline_2)
concat = Concatenate(FragmentA="data", FragmentB=".obj")
convquads = MeshConvertQuads(Mesh=meshify_2, ShortDiagonal=True)  # -> Mesh, Splitted
lowerleftpoint = LowerLeftPoint(geo=meshify)
geo = Geometry(<point referenced from the Rhino model>)
save = ObjectSave(
    BakeToggle=saveobj,
    FileDirectory=join,
    FileName=concat,
    GeometryObjects=convquads.Mesh,
    Layer="GH_Export",
    ObjectName="GH_Obj",
    ObjectColor=RGB(255, 255, 255),
    LayerColor=RGB(255, 255, 255))
scaledownup = ScaleDownUp(geo_3=lowerleftpoint, geo=meshify, B=geo, x=Slider(20, range=3..30))  # -> G_2, G
geo_2 = Geometry([meshify, scaledownup.G_2, scaledownup.G])
preview = CustomPreview(Geometry=flatten(geo_2), Shader=ColourSwatch(SwatchColor=RGB(117, 106, 106)))

# ==== cluster Meshify
S = ClusterInput()
geo = ClusterInput()
geo_2 = Geometry(geo)
brep = Brep(geo_2)
mesh = Mesh(geo_2)
clean = CleanTree(RemoveNulls=True, RemoveInvalid=True, RemoveEmpty=False, Tree=brep)
clean_2 = CleanTree(RemoveNulls=True, RemoveInvalid=True, RemoveEmpty=False, Tree=mesh)
mesh_2 = MeshBrep(Brep=clean, Settings=S)
geo_3 = Geometry([mesh_2, clean_2])
geo_4 = ClusterOutput(geo_3)

# ==== cluster ScaleDownUp
geo = ClusterInput()
pt = ConstructPoint(XCoordinate=0, YCoordinate=0, ZCoordinate=0)
geo_2 = Geometry(geo)
x = ClusterInput()
geo_3 = ClusterInput()
geo_4 = Geometry(geo_3)
one_over_x = OneOverX(Value=x)
scale = Scale(Geometry=geo_2, Center=geo_4, Factor=one_over_x)  # -> Geometry, Transform
one_over_x_2 = OneOverX(Value=one_over_x)
B = ClusterInput()
vec2pt = Vector2Pt(PointA=geo_4, PointB=B, Unitize=False)  # -> Vector, Length
scale_2 = Scale(Geometry=geo_2, Center=geo_4, Factor=one_over_x_2)  # -> Geometry, Transform
rev = Reverse(Vector=vec2pt.Vector)
multiplication = Multiplication(A=rev, B=one_over_x_2)
move = Move(Geometry=scale.Geometry, Motion=vec2pt.Vector)  # -> Geometry, Transform
move_2 = Move(Geometry=scale_2.Geometry, Motion=multiplication)  # -> Geometry, Transform
G = ClusterOutput(move.Geometry)
G_2 = ClusterOutput(move_2.Geometry)

# ==== cluster LowerLeftPoint
geo = ClusterInput()
geo_2 = Geometry(geo)
bbox = BoundingBox(Content=geo_2, Plane=PlaneXY(0, 0, 0), UnionBox=True)  # -> Box, Box_2
debrep = DeconstructBrep(Brep=bbox.Box)  # -> Faces, Edges, Vertices
sort_pt = SortPoints(Points=debrep.Vertices)  # -> Points, Indices
item = ListItem(List=sort_pt.Points, Index=0, Wrap=True)
pt = Geometry(item)
pt_2 = ClusterOutput(pt)

# ==== cluster Meshify_2
geo = ClusterInput()
geo_2 = Geometry(geo)
brep = Brep(geo_2)
mesh = Mesh(geo_2)
clean = CleanTree(RemoveNulls=True, RemoveInvalid=True, RemoveEmpty=False, Tree=brep)
S = ClusterInput()
clean_2 = CleanTree(RemoveNulls=True, RemoveInvalid=True, RemoveEmpty=False, Tree=mesh)
mesh_2 = MeshBrep(Brep=clean, Settings=S)
geo_3 = Geometry([mesh_2, clean_2])
geo_4 = ClusterOutput(geo_3)
